# Grasshopper definition LED_simulation.gh (Grasshopper 1.0.8)
# plug-ins: Bifocals

pt = Point(Point(0, 0, 0))
circle = CircleCNR(Center=pt, Normal=Vector(0, 0, 1), Radius=Slider(2.82, range=0..10))
len = Length(Curve=circle)

# ---- group: entrance arc percentage
division = Division(A=Slider(1.5, range=0..10), B=len)
panel = Panel(division)

# ----
panel_2 = Panel(len)
number_slider = Slider(0.08636, range=0..0.1)
number_slider_2 = Slider(0, range=0..1)
eval = EvaluateCurve(Curve=reparameterize(circle), Parameter=number_slider)  # -> Point, Tangent, Angle
eval_2 = EvaluateCurve(Curve=reparameterize(circle), Parameter=number_slider_2)  # -> Point, Tangent, Angle
merge = Merge(Data1=number_slider_2, Data2=number_slider)
shatter = Shatter(Curve=reparameterize(circle), Parameters=merge)
len_2 = Length(Curve=shatter)
panel_3 = Panel(shatter)
panel_4 = Panel(len_2)

# ---- group: booth wall arc
item = ListItem(List=shatter, Index=Slider(1, range=0..1), Wrap=True)

# ---- group: divide: center to center of strip
# if w = 0.012 m → pitch = 0.10 + 0.012 = 0.112 m
number_slider_3 = Slider(0.112, range=0..1)
len_3 = Length(Curve=item)
division_2 = Division(A=len_3, B=number_slider_3)

# ---- group: Pixel division
# 60 pixels/m
number_slider_4 = Slider(0.7, range=0..1)
# 146 vertical strips
divide = DivideCurve(Curve=item, Count=division_2, Kinks=False)  # -> Points, Tangents, Parameters
line = LineSDL(Start=divide.Points, Direction=Vector(0, 0, 1), Length=number_slider_4)
divide_2 = DivideCurve(Curve=line, Count=Slider(41, range=0..100), Kinks=False)  # -> Points, Tangents, Parameters

# ----
panel_5 = Panel("E:\Documents (E)\IAAC-Spain\1_YEAR 2025-2026\Semester_02\AI for ALL\spectrogram_to_csv\waveform.csv")
py3 = Python3Script(path=panel_5)  # -> ptsFlat, colors, debug; inputs path: String, ledPts: tree of Point3d
# ---------- py3: Python ----------
import csv, os
from System.Drawing import Color

# -------------------------
# 1) Read waveform.csv
# -------------------------
if not isinstance(path, str) or not os.path.exists(path):
    raise Exception("Bad path or file not found:\n" + str(path))

spec = []
with open(path, "r") as f:
    r = csv.reader(f)
    for row in r:
        if row:
            spec.append([float(x) for x in row])

if not spec:
    raise Exception("CSV is empty")

n_strips = len(spec)          # should be 146
n_leds = len(spec[0])         # should be 42
need = n_strips * n_leds

# -------------------------
# 2) Collect ALL LED points robustly (ignores weird tree nesting)
# -------------------------
flat_pts = []

def is_point(obj):
    return hasattr(obj, "X") and hasattr(obj, "Y") and hasattr(obj, "Z")

def walk(obj):
    # GH tree case
    if hasattr(obj, "Branches"):
        br = obj.Branches
        for i in range(br.Count):
            walk(br[i])
        return
    # Iterable case (lists/nested)
    if hasattr(obj, "__iter__") and not is_point(obj) and not isinstance(obj, (str, bytes)):
        for it in obj:
            walk(it)
        return
    # Point case
    if is_point(obj):
        flat_pts.append(obj)
        return

walk(ledPts)

if len(flat_pts) != need:
    raise Exception(
        f"Point count mismatch:\nHave {len(flat_pts)} points\nNeed {need} ({n_strips} x {n_leds})"
    )

# -------------------------
# 3) Map 0/1 waveform to colors (no gradient needed)
# -------------------------
ptsFlat = flat_pts

# Build values strip-by-strip then color them
vals = [spec[i][j] for i in range(n_strips) for j in range(n_leds)]

colors = []
for v in vals:
    if v > 0.5:
        colors.append(Color.Cyan)                # waveform "ON"
    else:
        colors.append(Color.FromArgb(25,25,25))  # background dim

vmin = min(vals)
vmax = max(vals)
debug = f"OK. CSV={n_strips}x{n_leds}, pts={len(ptsFlat)}, vals range={vmin}..{vmax}"
# ---------- end py3 ----------
sph = Sphere(Base=py3.ptsFlat, Radius="0.01")
preview = CustomPreview(Geometry=sph, Material=py3.colors)
